% Simulink data dictionary configuration_dictionary.sldd

gearbox_ratio = Simulink.Parameter(40.61)
wheel_diameter = Simulink.Parameter(360, Unit="mm")
tstep = Simulink.Parameter(0.001, Unit="s")
joy_max_speed_multiplier = Simulink.Parameter(7)
joy_boost_speed_multiplier = Simulink.Parameter(4)
SharedConfig = Simulink.ConfigSet(StartTime="0", StopTime="inf", FixedStep="1e-3", Solver="FixedStepAuto", ProdHWDeviceType="Intel->x86-64 (Linux 64)", SystemTargetFile="speedgoat.tlc", TargetLang="C++")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
joy_max_steering_angle = Simulink.Parameter(1.047198, Unit="rad")
Sig = Simulink.Signal()
max_curtis_speed = Simulink.Parameter(3000, Unit="rpm")
joy_rpm = Simulink.Parameter(300, Unit="rpm")
vehicle_wheelbase = Simulink.Parameter(2367, Unit="mm")
Sig1 = Simulink.Signal()
vehicle_track = Simulink.Parameter(877, Unit="mm")
Sig2 = Simulink.Signal()